# Grasshopper definition MIDAS Grillage & Piles_WIP.gh (Grasshopper 1.0.7)

# ---- group: Cross Sect Inputs
width_of_x_section = Slider(22, range=0..30)
no_increments = Slider(11, range=0..30)
edge_dist = Slider(0.6, range=0..30)

# ---- group: Span by seg length
seg_length = Slider(2.85, range=0..40)
span = Slider(28.5, range=0..40)
division = Division(A=span, B=seg_length)
dup = DuplicateData(Data=seg_length, Number=division, Order=True)

# ---- group: Span by increm
# Choose one of the below purple options for the span arrangement.
# Then connect 'D' to 'I' for the chosen option.
span_2 = Slider(28.5, range=0..30)
no_increments_2 = Slider(20, range=0..30)
division_2 = Division(A=span_2, B=no_increments_2)
dup_2 = DuplicateData(Data=division_2, Number=no_increments_2, Order=True)

# ----
division_3 = Division(A=width_of_x_section, B=no_increments)
dup_3 = DuplicateData(Data=division_3, Number=no_increments, Order=True)
entwine = Entwine(Branch00=Slider(0, range=0..20), Branch01=edge_dist, Branch02=dup_3, Branch03=edge_dist, FlattenInputs=True)  # -> flatten(Result)
ma = MassAddition(Input=entwine)  # -> Result, PartialResults
ma_2 = MassAddition(Input=dup_2)  # -> Result, PartialResults
pt = ConstructPoint(XCoordinate=0, YCoordinate=0, ZCoordinate=0)
Y = UnitY(Factor=ma.PartialResults)
entwine_2 = Entwine(Branch00=Slider(0, range=0..20), Branch01=ma_2.PartialResults, FlattenInputs=True)  # -> flatten(Result)
move = Move(Geometry=pt, Motion=Y)  # -> Geometry, Transform
pline = PolyLine(Vertices=move.Geometry, Closed=False)
X = UnitX(Factor=entwine_2)

# ---- group: Pile Inputs
pile = Slider(25.5, range=0..30)  # disabled
no_increments_3 = Slider(10, range=0..30)  # disabled
division_4 = Division(A=pile, B=no_increments_3)  # disabled
dup_4 = DuplicateData(Data=division_4, Number=no_increments_3, Order=True)  # disabled

# ----
move_2 = Move(Geometry=pline, Motion=X)  # -> Geometry, Transform
explode = Explode(Curve=move_2.Geometry, Recursive=True)  # -> Segments, Vertices
flip = FlipMatrix(Data=explode.Vertices)
pline_2 = PolyLine(Vertices=flip, Closed=False)
panel = Panel("""0
-1""")
tstat = TreeStatistics(Tree=explode.Segments)  # -> Paths, Length, Count
explode_2 = Explode(Curve=pline_2, Recursive=True)  # -> Segments, Vertices
panel_2 = Panel("""0
-1""")
tstat_2 = TreeStatistics(Tree=explode_2.Segments)  # -> Paths, Length, Count
geo = Geometry(explode.Vertices)
cull_i = CullIndex(List=tstat.Paths, Indices=panel, Wrap=True)
item = ListItem(List=tstat.Paths, Index=panel, Wrap=True)  # -> Item1, Item
cull_i_2 = CullIndex(List=tstat_2.Paths, Indices=panel_2, Wrap=True)
item_2 = ListItem(List=tstat_2.Paths, Index=panel_2, Wrap=True)  # -> Item1, Item
entwine_3 = Entwine(Branch00=Slider(0, range=0..100), Branch01=dup_4, FlattenInputs=True)  # -> flatten(Result)
ma_3 = MassAddition(Input=entwine_3)  # -> Result, PartialResults
neg = Negative(Value=ma_3.PartialResults)

# ---- group: Elements to 'bake'
# Bake this only for transverse members, if seperation into edge transverse + transverse is NOT required.
transverse = Geometry(explode.Segments)  # disabled
edge_long = TreeBranch(Tree=explode_2.Segments, Path=item_2.Item, MaintainPaths=True)
# Note: if edge dist is not specified / required, then 'bake' edge long and girders together into 1 layer.
girders = TreeBranch(Tree=explode_2.Segments, Path=cull_i_2, MaintainPaths=True)
edge_trans = TreeBranch(Tree=explode.Segments, Path=item.Item, MaintainPaths=True)
transverse_2 = TreeBranch(Tree=explode.Segments, Path=cull_i, MaintainPaths=True)

# ----
Z = UnitZ(Factor=neg)
move_3 = Move(Geometry=graft(explode.Vertices), Motion=Z)  # -> Geometry, Transform
